# Grasshopper definition CatenaryTree.ghx (Grasshopper 0.9.76)

digit_scroller = DigitScroller(Scroller_Digits=12, Scroller_Prefix="Seed", Scroller_Radix=11, Scroller_Value=8)
digit_scroller_2 = DigitScroller(Scroller_Digits=12, Scroller_Prefix="Count", Scroller_Radix=11, Scroller_Value=17)
md_slider = MDSlider(
    slider_value=Point(0.2304877304, 0.2835365854, 0.5),
    SliderMode=0,
    x_domain=Domain(-200, 200),
    y_domain=Domain(-200, 200),
    z_domain=Domain(0, 1))
md_slider_2 = MDSlider(
    slider_value=Point(0.8063583374, 0.8298784582, 0.5),
    SliderMode=0,
    x_domain=Domain(-200, 200),
    y_domain=Domain(-200, 200),
    z_domain=Domain(0, 1))
rectangle = Rectangle(Plane=PlaneXY(0, 0, 0), XSize="-200 to 200", YSize="-200 to 200", Radius=0)  # -> Rectangle, Length
pop2d = Populate2D(Region=rectangle.Rectangle, Count=digit_scroller_2, Seed=digit_scroller)
digit_scroller_3 = DigitScroller(Scroller_Digits=12, Scroller_Prefix="Radius", Scroller_Radix=11, Scroller_Value=26)
merge = Merge(Data1=md_slider_2, Data2=md_slider)  # -> graft(Result)
dist = Distance(PointA=pop2d, PointB=merge)
cir = Circle(Plane=merge, Radius=digit_scroller_3)
cat = Catenary(PointA=pop2d, PointB=merge, Length=expr("x*1.5", dist), Gravity=Vector(0, 0, 111.4929721))
crv_cp = CurveClosestPoint(Point=pop2d, Curve=cir)  # -> Point, Parameter, Distance
sort = SortList(Keys=crv_cp.Parameter, ValuesA=cat)  # -> Keys, ValuesA
viewer = ParamViewer(cat)
shatter = Shatter(Curve=reparameterize(sort.ValuesA), Parameters="0.5")
pshift = ShiftPaths(Data=shatter, Offset=-1)
lng = ListLength(List=pshift)
dup = DuplicateData(Data=merge, Number=lng, Order=True)
pshift_2 = ShiftPaths(Data=dup, Offset=-1)
partition = PartitionList(List=pshift_2, Size="2")
crv_cp_2 = CurveClosestPoint(Point=partition, Curve=shatter)  # -> Point, Parameter, Distance
sort_2 = SortList(Keys=crv_cp_2.Distance, ValuesA=shatter)  # -> Keys, ValuesA
pt = ConstructPoint(XCoordinate=0, YCoordinate=0, ZCoordinate=0)
item = ListItem(List=sort_2.ValuesA, Index=0, Wrap=True)
line = LineSDL(Start=pt, Direction=Vector(0, 0, 1), Length=1)
flip = FlipCurve(Curve=item, Guide=line)  # -> Curve, Flag
divide = DivideCurve(Curve=flip.Curve, Count=10, Kinks=False)  # -> simplify(graft(Points)), Tangents, Parameters
path_mapper = PathMapper(divide.Points, source="{A;B;C}", target="{A;C}")
pline = PolyLine(Vertices=path_mapper, Closed=True)
intcrv = Interpolate(Vertices=path_mapper, Degree=3, Periodic=True, KnotStyle=1)  # -> Curve, Length, Domain
explode = Explode(Curve=pline, Recursive=True)  # -> Segments, Vertices
divide_2 = DivideCurve(Curve=explode.Segments, Count=10, Kinks=False)  # -> simplify(graft(Points)), Tangents, Parameters
path_mapper_2 = PathMapper(divide_2.Points, source="{A;B;C;D}", target="{A;B;D}")
pline_2 = PolyLine(Vertices=path_mapper_2, Closed=False)
