# Grasshopper definition Courtyard generation tool applied to the Urban Plot Layout - Nov2014.ghx (Grasshopper 0.9.76)

# ---- group: surface construction - insert block surfaces here
digit_scroller = DigitScroller(Scroller_Digits=12, Scroller_Prefix="X coordinate", Scroller_Radix=11, Scroller_Value=142)
digit_scroller_2 = DigitScroller(Scroller_Digits=12, Scroller_Prefix="Y coordinate", Scroller_Radix=11, Scroller_Value=337)
pt = ConstructPoint(XCoordinate=0, YCoordinate=0, ZCoordinate=0)
pt_2 = ConstructPoint(XCoordinate=0, YCoordinate=digit_scroller_2, ZCoordinate=0)
pt_3 = ConstructPoint(XCoordinate=digit_scroller, YCoordinate=digit_scroller_2, ZCoordinate=0)
pt_4 = ConstructPoint(XCoordinate=digit_scroller, YCoordinate=0, ZCoordinate=0)
srf4pt = _4PointSurface(CornerA=pt, CornerB=pt_2, CornerC=pt_3, CornerD=pt_4)

# ---- group: block divider into plots
srf = Surface(srf4pt)
dim = Dimensions(Surface=srf)  # -> graft(UDimension), graft(VDimension)
merge = Merge(Data1=dim.UDimension, Data2=dim.VDimension)
panel = Panel("60")

# ---- group: block divider into plots / how to make this simpler?
expression = Expression(x=merge, y=panel, Expression="x/y")
floor_area_ratio = Panel("""0
1""")
sort = SortList(Keys=expression, ValuesA=floor_area_ratio)  # -> Keys, ValuesA
replace = ReplaceItems(List=sort.Keys, Item="2", Indices="0", Wrap=False)
sort_2 = SortList(Keys=sort.ValuesA, ValuesA=replace)  # -> Keys, ValuesA
round = Round(Number=sort_2.ValuesA)  # -> Nearest, Floor, Ceiling

# ---- group: block divider into plots (continued)
dispatch = Dispatch(List=round.Ceiling, DispatchPattern=[True, False])  # -> ListA, ListB
divide = DivideDomain²(Domain=srf, UCount=flatten(dispatch.ListA), VCount=flatten(dispatch.ListB))
subsrf = Isotrim(Surface=graft(srf), Domain=divide)  # -> flatten(Surface)

# ----
digit_scroller_3 = DigitScroller(Scroller_Digits=12, Scroller_Prefix="A", Scroller_Radix=11, Scroller_Value=2025)
lng = ListLength(List=subsrf)
offset = Panel("8")
series = Series(Start=0, Step=1, Count=lng)
division = Division(A=digit_scroller_3, B=lng)
cluster = Cluster(curve=subsrf, offset=offset)  # -> curve_2, curve_3
in_model_units = DigitScroller(Scroller_Digits=12, Scroller_Prefix="IN MODEL UNITS", Scroller_Radix=11, Scroller_Value=24)
popgeo = PopulateGeometry(Geometry=subsrf, Count=division, Seed=series)
srf_2 = Surface(cluster.curve_2)
digit_scroller_4 = DigitScroller(Scroller_Digits=12, Scroller_Prefix="Count", Scroller_Radix=11, Scroller_Value=7)
incurves = PointInCurves(Point=popgeo, Curves=srf_2)  # -> Relationship, Index, Point
cull = CullPattern(List=popgeo, CullPattern=invert(incurves.Relationship))
cullpt = CullDuplicates(Points=cull, Tolerance=in_model_units, CullMode=3)  # -> Points, Indices, Valence
digit_scroller_5 = DigitScroller(Scroller_Digits=12, Scroller_Prefix="Factor", Scroller_Radix=11, Scroller_Value=12)
cps = ClosestPoints(Point=cullpt.Points, Cloud=cull, Count=digit_scroller_4)  # -> ClosestPoint, CPIndex, Distance
bbox = BoundingBox(Content=cps.ClosestPoint, Plane=PlaneXY(0, 0, 0), UnionBox=True)  # -> Box, Box_2
srf_3 = Surface(simplify(bbox.Box))
Z = UnitZ(Factor=digit_scroller_5)
pshift = ShiftPaths(Data=srf_3, Offset=-1)
extr = Extrude(Base=graft(subsrf), Direction=Z)
extr_2 = Extrude(Base=pshift, Direction=Z)
sdiff = SolidDifference(BrepsA=extr, BrepsB=extr_2)

# ==== cluster Cluster
curve = ClusterInput()  # Curve you want to offset
offset = ClusterInput()  # Offset amount
crv = Curve(curve)
num = Number(offset)
offset_2 = Offset(Curve=crv, Distance=expr("-x", num), Plane=PlaneXY(0, 0, 0), Corners=1)
offset_3 = Offset(Curve=crv, Distance=num, Plane=PlaneXY(0, 0, 0), Corners=1)
merge = Merge(Data1=offset_3, Data2=offset_2)
len = Length(Curve=merge)
sort = SortList(Keys=len, ValuesA=merge)  # -> Keys, ValuesA
dispatch = Dispatch(List=sort.ValuesA, DispatchPattern=[True, False])  # -> ListA, ListB
crv_2 = Curve(dispatch.ListB)
crv_3 = Curve(dispatch.ListA)
curve_2 = ClusterOutput(crv_3)  # shortest curve length
curve_3 = ClusterOutput(crv_2)  # longest curve length
