# Grasshopper definition GENERATIVE HOUSE first Demo Dec 2014.ghx (Grasshopper 0.9.76)

digit_scroller = DigitScroller(Scroller_Digits=12, Scroller_Prefix="X Size", Scroller_Radix=11, Scroller_Value=30)
digit_scroller_2 = DigitScroller(Scroller_Digits=12, Scroller_Prefix="Y Size", Scroller_Radix=11, Scroller_Value=50)
# Family members.
grandparents = Slider(1, range=0..1)
parents = Slider(2, range=0..2)
sons = Slider(0, range=0..4)
daughters = Slider(1, range=0..4)
parents_bedroom = Panel("1")
# Plot of land
rectangle = Rectangle(Plane=PlaneXY(0, 0, 0), XSize=digit_scroller, YSize=digit_scroller_2, Radius=0)  # -> Rectangle, Length
multiplication = Multiplication(A="12", B="3")
pop2d = Populate2D(Region=rectangle.Rectangle, Count=100, Seed=1)
boxrec = BoxRectangle(Rectangle=rectangle.Rectangle, Height=multiplication)
# Start with the number of bedrooms
# redundant elements are for refination needed later
addition = Addition(A=grandparents, B=parents_bedroom)
addition_2 = Addition(A=sons, B=daughters)
int = Integer(addition)
int_2 = Integer(addition_2)
merge = Merge(Data1=grandparents, Data2=parents, Data3=int_2)
number_of_regular_bedrooms = Panel(int_2)
number_of_master_bedrooms = Panel(int)
ma = MassAddition(Input=merge)  # -> Result, PartialResults
number_of_inhabitants = Panel(ma.Result)
division = Division(A="12", B="2")
division_2 = Division(A="16", B="2")
division_3 = Division(A="12", B="2")
division_4 = Division(A="20", B="2")
neg = Negative(Value=division)
neg_2 = Negative(Value=division_2)
neg_3 = Negative(Value=division_3)
neg_4 = Negative(Value=division_4)
dom = ConstructDomain(DomainStart=neg_2, DomainEnd=division_2)
dom_2 = ConstructDomain(DomainStart=neg, DomainEnd=division)
# Master Bedroom
item = ListItem(List=pop2d, Index=0, Wrap=True)  # -> Item1, Item
# Regular Bedroom
item_2 = ListItem(List=pop2d, Index=0, Wrap=True)
dom_3 = ConstructDomain(DomainStart=neg_4, DomainEnd=division_4)
dom_4 = ConstructDomain(DomainStart=neg_3, DomainEnd=division_3)
addition_3 = Addition(A=number_of_master_bedrooms, B=number_of_regular_bedrooms)
rectangle_2 = Rectangle(Plane=item_2, XSize=dom_2, YSize=dom, Radius=0)  # -> Rectangle, Length
rectangle_3 = Rectangle(Plane=item.Item1, XSize=dom_4, YSize=dom_3, Radius=0)  # -> Rectangle, Length
number_of_bedrooms = Panel(addition_3)
boxrec_2 = BoxRectangle(Rectangle=rectangle_2.Rectangle, Height="11")
boxrec_3 = BoxRectangle(Rectangle=rectangle_3.Rectangle, Height="11")

arrlinear = LinearArray(Geometry=boxrec_3, Direction=Vector(10, 0, 0), Count=number_of_master_bedrooms)  # -> Geometry, Transform
arrlinear_2 = LinearArray(Geometry=boxrec_2, Direction=Vector(10, 0, 0), Count=number_of_regular_bedrooms)  # -> Geometry, Transform
merge_2 = Merge(Data1=arrlinear.Geometry, Data2=arrlinear_2.Geometry)
# Total area of bedrooms
debrep = DeconstructBrep(Brep=merge_2)  # -> simplify(Faces), Edges, Vertices
area = Area(Geometry=debrep.Faces)  # -> Area, Centroid
pdecon = Deconstruct(Point=area.Centroid)  # -> XComponent, YComponent, ZComponent
sort = SortList(Keys=pdecon.ZComponent, ValuesA=area.Area)  # -> Keys, ValuesA
item_3 = ListItem(List=sort.ValuesA, Index=0, Wrap=True)  # -> flatten(Item)
bedroom_areas = Panel(item_3)

# ----
# Reception area - includes a check whether it is needed or not.
# Area = Half of living
int_3 = Integer(number_of_inhabitants)
ma_2 = MassAddition(Input=bedroom_areas)  # -> Result, PartialResults
expression = Expression(x=int_3, Expression="If( x ≥ 5, 1, 0 )")
division_5 = Division(A=ma_2.Result, B="2")
item_4 = ListItem(List=pop2d, Index=0, Wrap=True)  # -> Item, Item1
# Living Room. Area = total bedrooms area
sqrt = SquareRoot(Value=ma_2.Result)
sqrt_2 = SquareRoot(Value=division_5)
division_6 = Division(A=sqrt, B="2")
division_7 = Division(A=sqrt_2, B="2")
filter = StreamFilter(Gate=expression, Stream1=item_4.Item1)
neg_5 = Negative(Value=division_6)
area_2 = Area(Geometry=rectangle.Rectangle)  # -> Area, Centroid
neg_6 = Negative(Value=division_7)

x = Slider(-18.416, range=-50..50)
y = Slider(1.155, range=-50..50)
z = Slider(0, range=0..2)
multiplication_2 = Multiplication(A=z, B="12")

x_2 = Slider(14.826, range=-50..50)
y_2 = Slider(17.658, range=-50..50)
z_2 = Slider(1, range=0..2)
multiplication_3 = Multiplication(A=z_2, B="12")

x_3 = Slider(-8.225, range=-50..50)
y_3 = Slider(9.892, range=-50..50)
z_3 = Slider(1, range=0..2)
multiplication_4 = Multiplication(A=z_3, B="12")

x_4 = Slider(11.472, range=-50..50)
y_4 = Slider(5.977, range=-50..50)
z_4 = Slider(1, range=0..2)
multiplication_5 = Multiplication(A=z_4, B="12")

x_5 = Slider(-3.91, range=-50..50)
z_5 = Slider(0, range=0..2)
y_5 = Slider(11.979, range=-50..50)
multiplication_6 = Multiplication(A=z_5, B="12")

x_6 = Slider(21.345, range=-50..50)
y_6 = Slider(-30.233, range=-50..50)
z_6 = Slider(0, range=0..2)
multiplication_7 = Multiplication(A=z_6, B="12")

x_7 = Slider(-5.662, range=-50..50)
y_7 = Slider(-29.674, range=-50..50)
z_7 = Slider(0, range=0..2)
multiplication_8 = Multiplication(A=z_7, B="12")

x_8 = Slider(39.449, range=-50..50)
y_8 = Slider(-37.63, range=-50..50)
z_8 = Slider(0, range=0..2)
multiplication_9 = Multiplication(A=z_8, B="12")

x_9 = Slider(-23.72, range=-50..50)
z_9 = Slider(0, range=0..2)
y_9 = Slider(31.259, range=-50..50)
multiplication_10 = Multiplication(A=z_9, B="12")

x_10 = Slider(22.794, range=-50..50)
y_10 = Slider(-28.98, range=-50..50)
z_10 = Slider(1, range=0..2)
multiplication_11 = Multiplication(A=z_10, B="12")

dom_5 = ConstructDomain(DomainStart=neg_5, DomainEnd=division_6)
dom_6 = ConstructDomain(DomainStart=neg_6, DomainEnd=division_7)
number_slider = Slider(2, range=-50..50)
number_slider_2 = Slider(3, range=-50..50)
list_of_bedrooms = Box(merge_2)
rectangle_4 = Rectangle(Plane=area_2.Centroid, XSize=dom_5, YSize=dom_5, Radius=0)  # -> Rectangle, Length
rectangle_5 = Rectangle(Plane=filter, XSize=dom_6, YSize=dom_6, Radius=0)  # -> Rectangle, Length
boxrec_4 = BoxRectangle(Rectangle=rectangle_4.Rectangle, Height="11")
boxrec_5 = BoxRectangle(Rectangle=rectangle_5.Rectangle, Height="11")

vec = VectorXYZ(XComponent=x_2, YComponent=y_2, ZComponent=multiplication_3)  # -> Vector, Length
vec_2 = VectorXYZ(XComponent=x_3, YComponent=y_3, ZComponent=multiplication_4)  # -> Vector, Length
vec_3 = VectorXYZ(XComponent=x_4, YComponent=y_4, ZComponent=multiplication_5)  # -> Vector, Length
vec_4 = VectorXYZ(XComponent=x, YComponent=y, ZComponent=multiplication_2)  # -> Vector, Length
vec_5 = VectorXYZ(XComponent=x_5, YComponent=y_5, ZComponent=multiplication_6)  # -> Vector, Length
vec_6 = VectorXYZ(XComponent=x_7, YComponent=y_7, ZComponent=multiplication_8)  # -> Vector, Length
vec_7 = VectorXYZ(XComponent=x_9, YComponent=y_9, ZComponent=multiplication_10)  # -> Vector, Length
vec_8 = VectorXYZ(XComponent=x_6, YComponent=y_6, ZComponent=multiplication_7)  # -> Vector, Length
vec_9 = VectorXYZ(XComponent=x_8, YComponent=y_8, ZComponent=multiplication_9)  # -> Vector, Length
vec_10 = VectorXYZ(XComponent=x_10, YComponent=y_10, ZComponent=multiplication_11)  # -> Vector, Length
merge_3 = Merge(
    Data1=vec.Vector,
    Data2=vec_2.Vector,
    Data3=vec_3.Vector,
    Data4=vec_4.Vector,
    Data5=vec_5.Vector,
    Data6=vec_6.Vector,
    Data7=vec_7.Vector,
    Data8=vec_8.Vector,
    Data9=vec_9.Vector,
    Data10=vec_10.Vector)
merge_4 = Merge(Data1=z_2, Data2=z_3, Data3=z_4, Data4=z, Data5=z_5, Data6=z_7, Data7=z_9, Data8=z_6, Data9=z_8, Data10=z_10)
lng = ListLength(List=list_of_bedrooms)
partition = PartitionList(List=merge_4, Size=lng)  # -> simplify(Chunks)
partition_2 = PartitionList(List=merge_3, Size=lng)  # -> simplify(Chunks)
branch = TreeBranch(Tree=partition, Path="0", MaintainPaths=True)
branch_2 = TreeBranch(Tree=partition_2, Path="0", MaintainPaths=True)

vec_11 = VectorXYZ(XComponent=number_slider, YComponent=number_slider_2, ZComponent=0)  # -> Vector, Length
reception = Box(boxrec_5)
volume = Volume(Geometry=boxrec_4)  # -> Volume, Centroid
move = Move(Geometry=reception, Motion=vec_11.Vector)  # -> Geometry, Transform
volume_2 = Volume(Geometry=move.Geometry)  # -> Volume, Centroid
move_2 = Move(Geometry=list_of_bedrooms, Motion=branch_2)  # -> Geometry, Transform
ln = Line(StartPoint=volume.Centroid, EndPoint=volume_2.Centroid)
volume_3 = Volume(Geometry=move_2.Geometry)  # -> Volume, Centroid
ln_2 = Line(StartPoint=volume.Centroid, EndPoint=volume_3.Centroid)
len = Length(Curve=ln)
len_2 = Length(Curve=ln_2)
expression_2 = Expression(x=len, Expression="x * 10")
expression_3 = Expression(x=len_2, Expression="x * 10")
merge_5 = Merge(Data1=move.Geometry, Data2=move_2.Geometry, Data3=boxrec_4)  # -> simplify(flatten(Result))
divide = DivideCurve(Curve=ln, Count=expression_2, Kinks=False)  # -> Points, Tangents, Parameters
divide_2 = DivideCurve(Curve=ln_2, Count=expression_3, Kinks=False)  # -> Points, Tangents, Parameters
null = NullItem(Item=merge_5)  # -> NullFlags, InvalidFlags, Description
cull = CullPattern(List=merge_5, CullPattern=invert(null.NullFlags))
debrep_2 = DeconstructBrep(Brep=move_2.Geometry)  # -> Faces, Edges, Vertices
brepinc = PointInBrep(Brep=boxrec_4, Point=divide_2.Points, Strict=False)
brepinc_2 = PointInBrep(Brep=move_2.Geometry, Point=divide_2.Points, Strict=False)
brepinc_3 = PointInBrep(Brep=boxrec_4, Point=divide.Points, Strict=False)
brepinc_4 = PointInBrep(Brep=move.Geometry, Point=divide.Points, Strict=False)
debrep_3 = DeconstructBrep(Brep=move.Geometry)  # -> Faces, Edges, Vertices

# ---- group: test of whether bedroom intersect or not
box = Box(cull)
sunion = SolidUnion(Breps=box)
lng_2 = ListLength(List=sunion)
lng_3 = ListLength(List=box)
subtraction = Subtraction(A=lng_2, B=lng_3)
abs = Absolute(Value=subtraction)
expression_4 = Expression(x=abs, Expression="x * 100000")

# ----
or = GateOr(A=brepinc, B=brepinc_2)
or_2 = GateOr(A=brepinc_3, B=brepinc_4)
brepinc_5 = PointInBrep(Brep=boxrec, Point=debrep_2.Vertices, Strict=False)
brepinc_6 = PointInBrep(Brep=boxrec, Point=debrep_3.Vertices, Strict=False)
cull_2 = CullPattern(List=or, CullPattern=invert(or))
cull_3 = CullPattern(List=or_2, CullPattern=invert(or_2))
cull_4 = CullPattern(List=brepinc_5, CullPattern=invert(brepinc_5))
cull_5 = CullPattern(List=brepinc_6, CullPattern=invert(brepinc_6))
lng_4 = ListLength(List=cull_2)  # -> flatten(Length)
lng_5 = ListLength(List=cull_3)  # -> flatten(Length)
lng_6 = ListLength(List=cull_4)  # -> flatten(Length)
lng_7 = ListLength(List=cull_5)  # -> flatten(Length)
_10º = PowerOf10(Value=branch)
expression_5 = Expression(x=lng_6, Expression="x * 1000")
expression_6 = Expression(x=lng_4, Expression="If( x < 1, 1000, x )")
expression_7 = Expression(x=lng_5, Expression="If( x < 1, 1000, x )")
expression_8 = Expression(x=lng_7, Expression="x * 1000")
subtraction_2 = Subtraction(A=_10º, B="1")
expression_9 = Expression(x=subtraction_2, Expression="x * 10")
subtraction_3 = Subtraction(A=expression_6, B="1")
subtraction_4 = Subtraction(A=expression_7, B="1")
ma_3 = MassAddition(Input=expression_9)  # -> Result, PartialResults
galapagos = Galapagos(fitness=num, gene=[number_slider_2, number_slider, x_2, y_2, z_2, x_3, y_3, z_3, x_4, y_4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])
panel = Panel(expression_5)
panel_2 = Panel(subtraction_3)
addition_4 = Addition(A=subtraction_4, B=expression_8)
addition_5 = Addition(A=panel_2, B=panel)
ma_4 = MassAddition(Input=addition_5)  # -> Result, PartialResults
panel_3 = Panel(addition_4)
panel_4 = Panel(ma_4.Result)
panel_5 = Panel(ma_3.Result)
panel_6 = Panel(expression_4)
rec = DataRecorder(DataLimit=-10, RecordData=False)
merge_6 = Merge(Data1=panel_3, Data2=panel_4, Data3=panel_5, Data4=panel_6)  # -> flatten(Result)

# ---- group: PREVIEW
panel_7 = Panel("100")
panel_8 = Panel("101")
panel_9 = Panel("102")
panel_10 = Panel("174")
panel_11 = Panel("202")
panel_12 = Panel("203")
panel_13 = Panel("43")
panel_14 = Panel("204")
panel_15 = Panel("51")
panel_16 = Panel("50")
panel_17 = Panel("51")
panel_18 = Panel("51")
panel_19 = Panel("51")
pt = Point(flatten([divide_2.Points, divide.Points]))

# ----
ma_5 = MassAddition(Input=merge_6)  # -> Result, PartialResults

# ---- group: PREVIEW / bedrooms
rgb = ColourRGB(Alpha=panel_7, Red=panel_8, Green=panel_9, Blue=panel_10)
preview = CustomPreview(Geometry=move_2.Geometry, Shader=rgb)

# ---- group: PREVIEW / living
rgb_2 = ColourRGB(Alpha=panel_7, Red=panel_11, Green=panel_12, Blue=panel_13)
preview_2 = CustomPreview(Geometry=boxrec_4, Shader=rgb_2)

# ----
panel_20 = Panel(ma_5.Result)

# ---- group: PREVIEW / reception
rgb_3 = ColourRGB(Alpha=panel_7, Red=panel_14, Green=panel_15, Blue=panel_16)
preview_3 = CustomPreview(Geometry=move.Geometry, Shader=rgb_3)

# ---- group: PREVIEW / points
rgb_4 = ColourRGB(Alpha=panel_7, Red=panel_17, Green=panel_18, Blue=panel_19)
preview_4 = CustomPreview(Geometry=pt, Shader=rgb_4)

# ----
num = Number(panel_20)
