# Grasshopper definition Roller coaster refinement Sep2014.ghx (Grasshopper 0.9.76)

# ---- group: Main Points
pt = ConstructPoint(XCoordinate="18", YCoordinate="26", ZCoordinate=Slider(0, range=0..20))
pt_2 = ConstructPoint(XCoordinate="0", YCoordinate="0", ZCoordinate="0")
pt_3 = ConstructPoint(XCoordinate="53", YCoordinate="14", ZCoordinate=Slider(0, range=0..20))

# ---- group: Loop Points
arc = Slider(10, range=0..10)
Y = UnitY(Factor=1)
amp = Amplitude(Vector=Y, Amplitude=arc)
multiplication = Multiplication(A=arc, B="2")
Z = UnitZ(Factor=1)
move = Move(Geometry=pt_2, Motion=amp)  # -> Geometry, Transform
amp_2 = Amplitude(Vector=Z, Amplitude=multiplication)
avr = Average(Input=[pt_2, move.Geometry])
move_2 = Move(Geometry=avr, Motion=amp_2)  # -> Geometry, Transform

# ---- group: Curve Construction
number_slider = Slider(48.04, range=25..50)
X = UnitX(Factor=1)
Z_2 = UnitZ(Factor=1)
vrot = Rotate(Vector=X, Axis=Z_2, Angle=Slider(1.038, range=0..6.283))
rev = Reverse(Vector=vrot)
arc_2 = ArcSED(Start=pt_2, End=move_2.Geometry, Direction=vrot)  # -> Arc, Plane, Radius
eval = EvaluateCurve(Curve=reparameterize(arc_2.Arc), Parameter="1")  # -> Point, Tangent, Angle
arc_3 = ArcSED(Start=eval.Point, End=move.Geometry, Direction=eval.Tangent)  # -> Arc, Plane, Radius
eval_2 = EvaluateCurve(Curve=reparameterize(arc_3.Arc), Parameter="1")  # -> Point, Tangent, Angle
arc_4 = ArcSED(Start=eval_2.Point, End=pt, Direction=eval_2.Tangent)  # -> Arc, Plane, Radius
eval_3 = EvaluateCurve(Curve=reparameterize(arc_4.Arc), Parameter="1")  # -> Point, Tangent, Angle
arc_5 = ArcSED(Start=eval_3.Point, End=pt_3, Direction=eval_3.Tangent)  # -> Arc, Plane, Radius
eval_4 = EvaluateCurve(Curve=reparameterize(arc_5.Arc), Parameter="1")  # -> Point, Tangent, Angle
amp_3 = Amplitude(Vector=eval_4.Tangent, Amplitude=number_slider)
amp_4 = Amplitude(Vector=rev, Amplitude=number_slider)
bzspan = BezierSpan(StartPoint=eval_4.Point, StartTangent=amp_3, EndPoint=pt_2, EndTangent=amp_4)  # -> Curve, Length, Domain

# ---- group: Cart
join = JoinCurves(Curves=[arc_4.Arc, arc_5.Arc, bzspan.Curve, arc_2.Arc, arc_3.Arc], Preserve=False)  # -> reparameterize(Curves)
eval_5 = EvaluateLength(Curve=join, Length=Slider(0.927, range=0..1), Normalized=True)  # -> Point, Tangent, Parameter
