# Grasshopper definition Saul Lewitt Sep2014.ghx (Grasshopper 0.9.76)

panel = Panel("MESSING AROUND VARIANT")

knob = ControlKnob(Decimals=2, Limit=True, Maximum=2, Minimum=-2, Range=2, Value=-1.26)
offset = Slider(7.416, range=-15..15)
count = Slider(10, range=1..30)
knob_2 = ControlKnob(Decimals=2, Limit=True, Maximum=2, Minimum=-2, Range=2, Value=0.04)
pi = Pi(Factor=knob)
pt = PointPolar(BasePlane="WorldXY", XYAngle=pi, ZAngle=0, Offset=Slider(15.631, range=0..30))
pl = ConstructPlane(Origin=pt, XAxis=Vector(1, 0, 0), YAxis=Vector(0, 1, 0))
pi_2 = Pi(Factor=knob_2)

number_slider = Slider(12, range=1..30)
knob_3 = ControlKnob(Decimals=2, Limit=False, Maximum=10, Minimum=0, Range=2, Value=0.26)
pt_2 = ConstructPoint(XCoordinate=Slider(16.608, range=1..30), YCoordinate=Slider(16.608, range=1..30), ZCoordinate=0)
pi_3 = Pi(Factor=knob_3)
pl_2 = ConstructPlane(Origin=pt_2, XAxis=Vector(1, 0, 0), YAxis=Vector(0, 1, 0))

cir = Circle(Plane=pl, Radius=Slider(30, range=1..30))
sqr = Square(Value=count)
offset_2 = Offset(Curve=cir, Distance=offset, Plane="WorldXY", Corners=1)
divide = DivideCurve(Curve=cir, Count=count, Kinks=False)  # -> Points, Tangents, Parameters
sqr_2 = Square(Value=number_slider)
cir_2 = Circle(Plane=pl_2, Radius=Slider(16.608, range=1..30))
offset_3 = Offset(Curve=cir_2, Distance=Slider(16.608, range=1..30), Plane=PlaneXY(0, 0, 0), Corners=1)
divide_2 = DivideCurve(Curve=offset_2, Count=sqr, Kinks=False)  # -> Points, Tangents, Parameters
rev = ReverseList(List=divide.Points)
rotate = Rotate(Geometry=divide_2.Points, Angle=pi_2, Plane=pl)  # -> Geometry, Transform
dom = ConstructDomain(DomainStart="0", DomainEnd=number_slider)
dom_2 = ConstructDomain(DomainStart="0", DomainEnd=number_slider)
divide_3 = DivideCurve(Curve=cir_2, Count=number_slider, Kinks=False)  # -> Points, Tangents, Parameters
divide_4 = DivideCurve(Curve=offset_3, Count=sqr_2, Kinks=False)  # -> Points, Tangents, Parameters

# ---- group: Switch it up
long = LongestList(ListA=rev, ListB=rotate.Geometry, PaddingMode=4)  # -> ListA, ListB
long_2 = LongestList(ListA=rev, ListB=rotate.Geometry, PaddingMode=5)  # -> ListA, ListB
long_3 = LongestList(ListA=rev, ListB=rotate.Geometry, PaddingMode=3)  # -> ListA, ListB
filter = StreamFilter(Gate=Slider(0, range=0..2), Stream0=long.ListA, Stream1=long_2.ListA, Stream2=long_3.ListA)
ln = Line(StartPoint=filter, EndPoint=long_3.ListB)

# ----
range = Range(Domain=dom_2, Steps=sqr_2)
range_2 = Range(Domain=dom, Steps=number_slider)
rev_2 = ReverseList(List=divide_3.Points)
rev_3 = ReverseList(List=divide_3.Tangents)
rotate_2 = Rotate(Geometry=divide_4.Points, Angle=pi_3, Plane=pl_2)  # -> Geometry, Transform
amp = Amplitude(Vector=divide_4.Tangents, Amplitude=range)
amp_2 = Amplitude(Vector=rev_3, Amplitude=range_2)

long_4 = LongestList(ListA=rev_2, ListB=rotate_2.Geometry, PaddingMode=4)  # -> ListA, ListB
long_5 = LongestList(ListA=amp_2, ListB=amp, PaddingMode=5)  # -> ListA, ListB

bzspan = BezierSpan(StartPoint=long_4.ListA, StartTangent=long_5.ListA, EndPoint=long_4.ListB, EndTangent=long_5.ListB)  # -> Curve, Length, Domain
rotate_3 = Rotate(Geometry=bzspan.Curve, Angle=pi_3, Plane=PlaneXY(0, 0, 0))  # -> Geometry, Transform
