# Grasshopper definition TV Simulation Oct2014.ghx (Grasshopper 0.9.76)

# ---- group: Screen Grab sampler
sqgrid = Square(Plane=PlaneXY(0, 0, 0), Size=1, ExtentX="3", ExtentY="11")  # -> Cells, flatten(Points)
move = Move(Geometry=sqgrid.Points, Motion="{0.5,0.5,0}")  # -> Geometry, Transform
panel = Panel(<missing>)

# ---- group: TV
xz = XZPlane(Origin=Point(0, 0, 0))
rectangle = Rectangle(Plane=xz, XSize="16", YSize="9", Radius=0)  # -> Rectangle, Length
Y = UnitY(Factor="0.5")
Z = UnitZ(Factor="4")
boundary = BoundarySurfaces(Edges=rectangle.Rectangle)
extr = Extrude(Base=boundary, Direction=Y)
move_2 = Move(Geometry=extr, Motion=Z)  # -> Geometry, Transform
preview = CustomPreview(Geometry=move_2.Geometry, Shader=ColourSwatch(SwatchColor=RGB(82, 82, 82)))

# ----
animate_this = Slider(47, range=0..47)
item = ListItem(List=panel, Index=animate_this, Wrap=True)

# ---- group: TV Reflection
neg = Negative(Value="16")
pt = ConstructPoint(XCoordinate=expr("x+8", "16"), YCoordinate=neg, ZCoordinate=0)
pt_2 = ConstructPoint(XCoordinate=expr("x-8", 0), YCoordinate=neg, ZCoordinate=0)
pt_3 = ConstructPoint(XCoordinate=0, YCoordinate=0, ZCoordinate=0)
pt_4 = ConstructPoint(XCoordinate="16", YCoordinate=0, ZCoordinate=0)
srf4pt = _4PointSurface(CornerA=pt_3, CornerB=pt_4, CornerC=pt, CornerD=pt_2)
preview_2 = CustomPreview(Geometry=srf4pt, Shader=item)

# ---- group: TV Surface
move_3 = Move(Geometry=rectangle.Rectangle, Motion=Z)  # -> Geometry, Transform

# ----
legend = Legend(Colour=panel, Tags=panel, Rectangle=move_3.Geometry, LegendType=1)
