# Grasshopper definition go board.ghx (Grasshopper 1.0.7)

board_width = DigitScroller(Scroller_Digits=12, Scroller_Prefix="Board Width", Scroller_Radix=9, Scroller_Value=424.2)
board_length = DigitScroller(Scroller_Digits=12, Scroller_Prefix="Board Length", Scroller_Radix=9, Scroller_Value=454.5)
horizontal_spacing = DigitScroller(Scroller_Digits=12, Scroller_Prefix="Horizontal Spacing", Scroller_Radix=9, Scroller_Value=22)
vertical_spacing = DigitScroller(Scroller_Digits=12, Scroller_Prefix="Vertical Spacing", Scroller_Radix=9, Scroller_Value=23.7)
board_size_1 = DigitScroller(Scroller_Digits=12, Scroller_Prefix="Board Size 1", Scroller_Radix=9, Scroller_Value=19)
board_size_2 = DigitScroller(Scroller_Digits=12, Scroller_Prefix="Board Size 2", Scroller_Radix=9, Scroller_Value=13)
board_size_3 = DigitScroller(Scroller_Digits=12, Scroller_Prefix="Board Size 3", Scroller_Radix=9, Scroller_Value=9)
star_point_line_for_largest = DigitScroller(Scroller_Digits=12, Scroller_Prefix="Star Point Line For Largest", Scroller_Radix=9, Scroller_Value=4)
star_point_line_for_smallest = DigitScroller(Scroller_Digits=12, Scroller_Prefix="Star Point Line For Smallest", Scroller_Radix=9, Scroller_Value=3)
line_thickness = DigitScroller(Scroller_Digits=12, Scroller_Prefix="Line Thickness", Scroller_Radix=9, Scroller_Value=1)
star_diameter = DigitScroller(Scroller_Digits=12, Scroller_Prefix="Star Diameter", Scroller_Radix=9, Scroller_Value=4)

# ---- group: Tengen
pt = ConstructPoint(XCoordinate=0, YCoordinate=0, ZCoordinate=0)

# ----
merge = Merge(Data1=board_size_1, Data2=board_size_2, Data3=board_size_3)
sort = SortList(Keys=merge)  # -> reverse(Keys), ValuesA
expression = Expression(x=sort.Keys, Expression="If(x%2=1,x,x-1)")
item = ListItem(List=expression, Index=0, Wrap=True)  # -> Item, Item1, Item2
cluster = Cluster_4(A=board_width)
cluster_2 = Cluster_4(A=board_length)
X = UnitX(Factor=horizontal_spacing)
Y = UnitY(Factor=vertical_spacing)
rectangle = Rectangle(Plane=pt, XSize=cluster, YSize=cluster_2, Radius=0)  # -> Rectangle, Length
rev = Reverse(Vector=X)
rev_2 = Reverse(Vector=Y)
expression_2 = Expression(x=item.Item, Expression="((x-1)/2)+1")
merge_2 = Merge(Data1=X, Data2=rev)
merge_3 = Merge(Data1=Y, Data2=rev_2)
arrlinear = LinearArray(Geometry=pt, Direction=merge_2, Count=expression_2)  # -> flatten(Geometry), Transform
expression_3 = Expression(x=star_diameter, Expression="x/2")
expression_4 = Expression(x=item.Item, y=item.Item2, Expression="(x-y)/2")
expression_5 = Expression(x=star_point_line_for_smallest, Expression="x-1")
arrlinear_2 = LinearArray(Geometry=graft(arrlinear.Geometry), Direction=merge_3, Count=expression_2)  # -> flatten(Geometry), Transform
subtraction = Subtraction(A=item.Item2, B=star_point_line_for_smallest)
expression_6 = Expression(x=star_point_line_for_largest, Expression="x-1")
expression_7 = Expression(x=item.Item, Expression="Floor(x/2)")
subtraction_2 = Subtraction(A=item.Item, B=star_point_line_for_largest)
cullpt = CullDuplicates(Points=arrlinear_2.Geometry, Tolerance=0.1, CullMode=1)  # -> Points, Indices, Valence
addition = Addition(A=expression_4, B=expression_5)
addition_2 = Addition(A=expression_4, B=subtraction)
digit_scroller = DigitScroller(Scroller_Digits=12, Scroller_Prefix="A", Scroller_Radix=9, Scroller_Value=6)
sort_pt = SortPoints(Points=cullpt.Points)  # -> Points, Indices
merge_4 = Merge(Data1=expression_6, Data2=expression_7, Data3=subtraction_2)
merge_5 = Merge(Data1=addition, Data2=addition_2)
partition = PartitionList(List=sort_pt.Points, Size=item.Item)
crossref = CrossReference(ListA=merge_4, ListB=merge_4, CrossMode=1)  # -> ListA, ListB
crossref_2 = CrossReference(ListA=merge_5, ListB=merge_5, CrossMode=1)  # -> ListA, ListB
flip = FlipMatrix(Data=partition)
path = ConstructPath(Indices=graft(crossref.ListA))  # -> flatten(Branch)
path_2 = ConstructPath(Indices=graft(crossref_2.ListA))  # -> flatten(Branch)
item_2 = ListItem(List=partition, Index=0, Wrap=True)  # -> Item1, Item
item_3 = ListItem(List=flip, Index=0, Wrap=True)  # -> Item1, Item
multiplication = Multiplication(A=digit_scroller, B=line_thickness)
item_4 = TreeItem(Tree=simplify(partition), Path=path, Index=crossref.ListB, Wrap=invert(True))
item_5 = TreeItem(Tree=simplify(partition), Path=path_2, Index=crossref_2.ListB, Wrap=invert(True))
ln = Line(StartPoint=item_2.Item1, EndPoint=item_2.Item)  # -> flatten(Line)
ln_2 = Line(StartPoint=item_3.Item1, EndPoint=item_3.Item)  # -> flatten(Line)
cluster_3 = Cluster_2(
    lines_to_work_on=ln,
    perpendicular_lines=ln_2,
    larger_board_size=item.Item,
    smaller_board_size=item.Item1,
    offset=multiplication)  # -> outer_lines, inner_lines
cluster_4 = Cluster_2(
    lines_to_work_on=ln_2,
    perpendicular_lines=ln,
    larger_board_size=item.Item,
    smaller_board_size=item.Item1,
    offset=multiplication)  # -> outer_lines, inner_lines

# ---- group: Larger Board Star Circles
cir = Circle(Plane=item_4, Radius=expression_3)

# ---- group: Smaller Board Star Circles
cir_2 = Circle(Plane=item_5, Radius=expression_3)

# ----
cluster_5 = Cluster_3(
    lines_to_work_on=cluster_3.inner_lines,
    perpendicular_lines=cluster_4.inner_lines,
    larger_board_size=item.Item1,
    smaller_board_size=item.Item2,
    offset=multiplication)  # -> outer_lines, inner_lines
cluster_6 = Cluster_3(
    lines_to_work_on=cluster_4.inner_lines,
    perpendicular_lines=cluster_3.inner_lines,
    larger_board_size=item.Item1,
    smaller_board_size=item.Item2,
    offset=multiplication)  # -> outer_lines, inner_lines

# ---- group: Middle Board Lines
merge_6 = Merge(Data1=cluster_5.outer_lines, Data2=cluster_6.outer_lines)

# ---- group: largest board lines
merge_7 = Merge(Data1=cluster_3.outer_lines, Data2=cluster_4.outer_lines)

# ---- group: Smaller Board Lines
merge_8 = Merge(Data1=cluster_5.inner_lines, Data2=cluster_6.inner_lines)

# ----
cluster_7 = Cluster(lines=merge_7, line_thickness=line_thickness)
cluster_8 = Cluster(lines=merge_8, line_thickness=line_thickness)
cluster_9 = Cluster(lines=merge_6, line_thickness=line_thickness)
srf = Surface(cluster_7)
srf_2 = Surface(cir)
srf_3 = Surface(cluster_9)
srf_4 = Surface(cluster_8)
srf_5 = Surface(cir_2)
preview = CustomPreview(Geometry=[srf, srf_2], Material="black")
preview_2 = CustomPreview(Geometry=srf_3, Material="red")
preview_3 = CustomPreview(Geometry=[srf_4, srf_5], Material="blue")

# ==== cluster Cluster
line_thickness = ClusterInput()
expression = Expression(x=line_thickness, Expression="x/2")
lines = ClusterInput()
neg = Negative(Value=expression)
flatten = FlattenTree(Tree=lines, Path="{0}")
graft = GraftTree(Tree=flatten, IncludeEmptyLists=True, IncludeNullItems=True)
merge = Merge(Data1=expression, Data2=neg)
offset = OffsetCurve(Curve=graft, Distance=merge, Plane=PlaneXY(0, 0, 0), Corners=1)
vec = Vector(graft)
trim = TrimTree(Tree=offset, Depth=1)
amp = Amplitude(Vector=vec, Amplitude=expression)
amp_2 = Amplitude(Vector=vec, Amplitude=neg)
end = EndPoints(Curve=trim)  # -> Start, End
move = Move(Geometry=end.Start, Motion=amp_2)  # -> Geometry, Transform
move_2 = Move(Geometry=end.End, Motion=amp)  # -> reverse(Geometry), Transform
merge_2 = Merge(Data1=move.Geometry, Data2=move_2.Geometry)
pline = PolyLine(Vertices=merge_2, Closed=invert(False))
pl = ClusterOutput(pline)

# ==== cluster Cluster_2
smaller_board_size = ClusterInput()
larger_board_size = ClusterInput()
expression = Expression(x=larger_board_size, y=smaller_board_size, Expression="(x-y)/2")
expression_2 = Expression(x=expression, y=smaller_board_size, Expression="x+y-1")
offset = ClusterInput()
dom = ConstructDomain(DomainStart=expression, DomainEnd=expression_2)
merge = Merge(Data1=expression, Data2=expression_2)
lines_to_work_on = ClusterInput()
perpendicular_lines = ClusterInput()
subset = SubList(List=lines_to_work_on, Domain=dom, Wrap=invert(True))  # -> List, Index
item = ListItem(List=perpendicular_lines, Index=merge, Wrap=True)
cull_i = CullIndex(List=lines_to_work_on, Indices=subset.Index, Wrap=invert(True))
llx = LineLine(Line1=graft(subset.List), Line2=item)  # -> ParamA, ParamB, PointA, PointB
shatter = Shatter(Curve=graft(subset.List), Parameters=llx.ParamA)
flip = FlipMatrix(Data=shatter)
bang = ExplodeTree(Data=flip)  # -> _0000, _0010, _0020
neg = Negative(Value=offset)
end = EndPoints(Curve=bang._0000)  # -> Start, End
amp = Amplitude(Vector=bang._0000, Amplitude=neg)
end_2 = EndPoints(Curve=bang._0020)  # -> Start, End
amp_2 = Amplitude(Vector=bang._0020, Amplitude=offset)
move = Move(Geometry=end.End, Motion=amp)  # -> Geometry, Transform
move_2 = Move(Geometry=end_2.Start, Motion=amp_2)  # -> Geometry, Transform
ln = Line(StartPoint=end.Start, EndPoint=move.Geometry)
ln_2 = Line(StartPoint=end_2.End, EndPoint=move_2.Geometry)
merge_2 = Merge(Data1=cull_i, Data2=ln, Data3=ln_2)
line = Line(bang._0010)
line_2 = Line(merge_2)
inner_lines = ClusterOutput(line)
outer_lines = ClusterOutput(line_2)

# ==== cluster Cluster_3
smaller_board_size = ClusterInput()
larger_board_size = ClusterInput()
expression = Expression(x=larger_board_size, y=smaller_board_size, Expression="(x-y)/2")
expression_2 = Expression(x=expression, y=smaller_board_size, Expression="x+y-1")
offset = ClusterInput()
dom = ConstructDomain(DomainStart=expression, DomainEnd=expression_2)
merge = Merge(Data1=expression, Data2=expression_2)
lines_to_work_on = ClusterInput()
perpendicular_lines = ClusterInput()
subset = SubList(List=lines_to_work_on, Domain=dom, Wrap=invert(True))  # -> List, Index
item = ListItem(List=perpendicular_lines, Index=merge, Wrap=True)
cull_i = CullIndex(List=lines_to_work_on, Indices=subset.Index, Wrap=invert(True))
llx = LineLine(Line1=graft(subset.List), Line2=item)  # -> ParamA, ParamB, PointA, PointB
shatter = Shatter(Curve=graft(subset.List), Parameters=llx.ParamA)
flip = FlipMatrix(Data=shatter)
bang = ExplodeTree(Data=flip)  # -> _0010000, _0010010, _0010020
neg = Negative(Value=offset)
end = EndPoints(Curve=bang._0010000)  # -> Start, End
amp = Amplitude(Vector=bang._0010000, Amplitude=neg)
end_2 = EndPoints(Curve=bang._0010020)  # -> Start, End
amp_2 = Amplitude(Vector=bang._0010020, Amplitude=offset)
move = Move(Geometry=end.End, Motion=amp)  # -> Geometry, Transform
move_2 = Move(Geometry=end_2.Start, Motion=amp_2)  # -> Geometry, Transform
ln = Line(StartPoint=end.Start, EndPoint=move.Geometry)
ln_2 = Line(StartPoint=end_2.End, EndPoint=move_2.Geometry)
merge_2 = Merge(Data1=cull_i, Data2=ln, Data3=ln_2)
line = Line(bang._0010010)
line_2 = Line(merge_2)
inner_lines = ClusterOutput(line)
outer_lines = ClusterOutput(line_2)

# ==== cluster Cluster_4
A = ClusterInput()
division = Division(A=A, B=2)
neg = Negative(Value=division)
dom = ConstructDomain(DomainStart=neg, DomainEnd=division)
I = ClusterOutput(dom)
