# Grasshopper definition louvers.ghx (Grasshopper 0.9.76)

xz = XZPlane(Origin=Point(0, 0, 0))
rectangle = Rectangle(Plane=xz, XSize=Slider(1200, range=0..10000), YSize=Slider(800, range=0..10000), Radius=0)  # -> Rectangle, Length
edges = BrepEdges(Brep=rectangle.Rectangle)  # -> Naked, Interior, NonManifold
louvers_width = Slider(100, range=0..10000)
curvepoint = PointOnCurve(edges.Naked, parameter=0.5)
pdecon = Deconstruct(Point=curvepoint)  # -> XComponent, YComponent, ZComponent
panel = Panel("""0
-1""")
sort = SortList(Keys=pdecon.ZComponent, ValuesA=edges.Naked)  # -> Keys, ValuesA
item = ListItem(List=sort.ValuesA, Index=panel, Wrap=True)
divlength = DivideLength(Curve=item, Length=louvers_width)  # -> Points, Tangents, Parameters
bang = ExplodeTree(Data=divlength.Points)  # -> Branch0, reverse(Branch1)
ln = Line(StartPoint=bang.Branch0, EndPoint=bang.Branch1)
cull_i = CullIndex(List=ln, Indices="-1", Wrap=True)
X = UnitX(Factor=1)
range = Range(Domain=Domain(0, 1), Steps="30")
divide = DivideCurve(Curve=cull_i, Count="30", Kinks=False)  # -> Points, Tangents, Parameters
graph = GraphMapper(range, x0=0, x1=1, y0=0, y1=1, container_name="Gaussian", factor=0.2495652437, mean=0.4933330119, sdev=0.1391301155)
bnd = Bounds(Numbers=graph)
line = LineSDL(Start=divide.Points, Direction=X, Length=louvers_width)
remap = RemapNumbers(Value=graph, Source=bnd, Target="30")  # -> Mapped, Clipped
rotate = Rotate(Geometry=line, Angle=degrees(remap.Mapped), Plane=divide.Points)  # -> Geometry, Transform
loft = Loft(Curves=rotate.Geometry, Options={Adjust=False, Closed=False, LoftEnds=0, LoftSimp=0, LoftType=0, Rebuild=10, Refit=0.01})
