# Grasshopper definition saudi houses block Oct2014.ghx (Grasshopper 0.9.76)

block_length_feet = Slider(300, range=200..500)
number_of_houses_in_block = Slider(6, range=5..15)
plot_depth_feet = Slider(65, range=0..100)
wall_thickness_inches = Slider(6, range=0..24)
wall_height_feet = Slider(12, range=0..15)
offset_feet = Slider(6, range=0..15)
division = Division(A=block_length_feet, B=number_of_houses_in_block)
plot_width = Panel(division)
expression = Expression(x=wall_height_feet, Expression="x*2")
expression_2 = Expression(x=wall_thickness_inches, Expression="x/12")
rectangle = Rectangle(Plane=PlaneXY(0, 0, 0), XSize=plot_width, YSize=plot_depth_feet, Radius=0)  # -> Rectangle, Length
offset = Offset(Curve=rectangle.Rectangle, Distance=expr("-x", offset_feet), Plane=PlaneXY(0, 0, 0), Corners=1)
offset_2 = Offset(Curve=rectangle.Rectangle, Distance=expr("-x", expression_2), Plane=PlaneXY(0, 0, 0), Corners=1)
boxrec = BoxRectangle(Rectangle=offset, Height=expression)
merge = Merge(Data1=rectangle.Rectangle, Data2=offset_2)  # -> flatten(Result)
debrep = DeconstructBrep(Brep=boxrec)  # -> Faces, Edges, Vertices
item = ListItem(List=debrep.Faces, Index="5", Wrap=True)
Z = UnitZ(Factor=wall_height_feet)
boundary = BoundarySurfaces(Edges=merge)
scale_nu = ScaleNU(Geometry=item, Plane=item, ScaleX=1, ScaleY="0.5", ScaleZ=1)  # -> Geometry, Transform
extr = Extrude(Base=boundary, Direction=Z)
boxrec_2 = BoxRectangle(Rectangle=scale_nu.Geometry, Height=wall_height_feet)
merge_2 = Merge(Data1=extr, Data2=boxrec, Data3=boxrec_2)  # -> flatten(Result)
join = BrepJoin(Breps=merge_2)  # -> Breps, Closed
arrbox = BoxArray(Geometry=join.Breps, Cell=rectangle.Rectangle, XCount=number_of_houses_in_block, YCount="2", ZCount=2)  # -> Geometry, Transform
