# Grasshopper definition t-shirt.ghx (Grasshopper 0.9.76)

expression = Expression(x="2", Expression="x * 3")
series = Series(Start="1", Step=expression, Count="3")
series_2 = Series(Start="0", Step="60", Count="3")
series_3 = Series(Start=series, Step="2", Count="3")  # -> flatten(Series)
pt = ConstructPoint(XCoordinate=series_2, YCoordinate=graft(series_2), ZCoordinate=0)  # -> flatten(Point)

offset = Slider(15, range=-15..15)
count = Slider(4, range=1..30)
pl = ConstructPlane(Origin=pt, XAxis=Vector(1, 0, 0), YAxis=Vector(0, 1, 0))
pi = Pi(Factor="0")

cir = Circle(Plane=pl, Radius=Slider(12.315, range=1..30))
sqr = Square(Value=series_3)
offset_2 = Offset(Curve=cir, Distance=offset, Plane=PlaneXY(0, 0, 0), Corners=1)  # -> flatten(Curve)
divide = DivideCurve(Curve=cir, Count=series_3, Kinks=False)  # -> Points, Tangents, Parameters
divide_2 = DivideCurve(Curve=offset_2, Count=sqr, Kinks=False)  # -> Points, Tangents, Parameters
cir_2 = Circle(Plane=flatten(divide.Points), Radius=1)
rev = ReverseList(List=divide.Points)
rotate = Rotate(Geometry=divide_2.Points, Angle=pi, Plane=pl)  # -> Geometry, Transform

# ---- group: Switch it up
long = LongestList(ListA=rev, ListB=rotate.Geometry, PaddingMode=4)  # -> ListA, ListB
long_2 = LongestList(ListA=rev, ListB=rotate.Geometry, PaddingMode=5)  # -> ListA, ListB
long_3 = LongestList(ListA=rev, ListB=rotate.Geometry, PaddingMode=3)  # -> ListA, ListB
filter = StreamFilter(Gate=Slider(0, range=0..2), Stream0=long.ListA, Stream1=long_2.ListA, Stream2=long_3.ListA)
ln = Line(StartPoint=filter, EndPoint=long_3.ListB)
