# Grasshopper definition trees Oct2014.ghx (Grasshopper 0.9.76)

branch_length = Slider(10.28, range=0..20)
branch_count = Slider(10, range=3..23)
tree_count_ish = Slider(25, range=4..25)
trunk_length = Slider(7.03, range=0..20)
leaves_count = Slider(9, range=0..20)
lines_shift = Slider(1, range=1..9)
pt = ConstructPoint(XCoordinate=0, YCoordinate=0, ZCoordinate=0)
rectangle = Rectangle(Plane=PlaneXY(0, 0, 0), XSize="75", YSize="75", Radius=0)  # -> Rectangle, Length
vec = VectorXYZ(XComponent="1", YComponent="1", ZComponent="1")  # -> Vector, Length
pop2d = Populate2D(Region=rectangle.Rectangle, Count=tree_count_ish, Seed=tree_count_ish, Points=pt)
Z = UnitZ(Factor=1)
pt_2 = Point(flatten([pop2d, pt]))
line = LineSDL(Start=pt_2, Direction=Z, Length=trunk_length)
eval = EvaluateCurve(Curve=reparameterize(line), Parameter="1")  # -> Point, Tangent, Angle
line_2 = LineSDL(Start=eval.Point, Direction=vec.Vector, Length=branch_length)
arrpolar = PolarArray(Geometry=line_2, Plane=pt_2, Count=branch_count, Angle=6.283185307)  # -> simplify(Geometry), Transform
divide = DivideCurve(Curve=arrpolar.Geometry, Count=leaves_count, Kinks=False)  # -> graft(Points), Tangents, Parameters
path_mapper = PathMapper(divide.Points, source="{A;B;C}", target="{A;C}")
shift = ShiftList(List=path_mapper, Shift=lines_shift, Wrap=True)
ln = Line(StartPoint=path_mapper, EndPoint=shift)  # -> simplify(Line)
graft = GraftTree(Tree=ln, IncludeEmptyLists=True, IncludeNullItems=True)
test_panel = Panel(ln)
viewer = ParamViewer(graft)
